# Dynamo graph SET_PFcalcs Manual Area input - CPC2019-422.1.dyn (Dynamo 2.3.0.5885)

# group: INPUTS
select_ga_plumbing_facilities = DSModelElementSelection()  # "Select "GA_Plumbing Facilities_Dyn" @ Z_001_Template Development"; 1 picked in the model; graph input
row_number = StringInput("1")  # graph input
occupancy_type_a_1_a_2_a_3_a_4_a = StringInput("A-1")  # "Occupancy Type : A-1,A-2,A-3,A-4,A-5,B,E,F1,F2,M,S-1,S-2"; graph input
area_manual_input = DoubleInput(1000)  # graph input

code_block = CodeBlock(a=row_number) { "R"+a+"_"; }
olf_per_occ_type = Python(IN[0]=occupancy_type_a_1_a_2_a_3_a_4_a)
# ---------- olf_per_occ_type.python (68 lines) ----------
# Load the Python Standard and DesignScript Libraries
import sys
import clr
clr.AddReference('ProtoGeometry')
from Autodesk.DesignScript.Geometry import *

# The inputs to this node will be stored as a list in the IN variables.

#INPUTS /rooms by iput level their areas and occ type
occup=IN[0]
# Place your code below this line
#emptyList = []
occupancytypes=("A-1","A-2","A-3","A-4","A-5","B","E","F1","F2","I-1","I-2","I-3","I-4","M","R-1","R-2","R-3","R-4","S-1","S-2")

out = []

if occup==occupancytypes[0]:
	out.append("15")
elif occup==occupancytypes[1]:
	out.append("30")
elif occup==occupancytypes[2]:
	out.append("30")
elif occup==occupancytypes[3]:
	out.append("30")
elif occup==occupancytypes[4]:
	out.append("30")
elif occup==occupancytypes[5]:
	out.append("200")
elif occup==occupancytypes[6]:
	out.append("50")
elif occup==occupancytypes[7]:
	out.append("2000")
elif occup==occupancytypes[8]:
	out.append("2000")
elif occup==occupancytypes[9]:
	out.append("200")
elif occup==occupancytypes[10]:
	out.append("200")
elif occup==occupancytypes[11]:
	out.append("200")
elif occup==occupancytypes[12]:
	out.append("200")
elif occup==occupancytypes[13]:
	out.append("200")
elif occup==occupancytypes[14]:
	out.append("200")
elif occup==occupancytypes[15]:
	out.append("200")
elif occup==occupancytypes[16]:
	out.append("200")
elif occup==occupancytypes[17]:
	out.append("200")
elif occup==occupancytypes[18]:
	out.append("5000")
elif occup==occupancytypes[19]:
	out.append("5000")
else:
	out.append("00")


# Assign your output to the OUT variable.

OUT = out

# This script was written by Agustina Aboy
# https://twitter.com/agusaboy
# Copyright (c) 2021 the ASG gang
# https://github.com/archsourcing/plumbing-fixture-calcs
# ----------------------------------------
watch = Watch(olf_per_occ_type)
toNumber = String.ToNumber(str=watch@L1)
OLF = Watch(toNumber)
code_block_2 = CodeBlock { ["wcm","wcf","ur","lvm","lvf","bth","df","ss"]; }
code_block_3 = CodeBlock(a=area_manual_input) { a>0; 0; }
if_ = If(test=code_block_3.out0, true=area_manual_input, false=code_block_3.out1)
area = Watch(if_)
code_block_4 = CodeBlock(AREA=area, OLF=OLF) { OL= AREA/OLF; }
occType = Watch(occupancy_type_a_1_a_2_a_3_a_4_a)
plumbing_fixture_calculations = Python(IN[0]=code_block_4, IN[1]=occType, IN[2]=OLF)
# ---------- plumbing_fixture_calculations.python (953 lines) ----------
import clr
import sys
sys.path.append('C:\Program Files (x86)\IronPython 2.7\Lib')
import System
from System import Array
from System.Collections.Generic import *
clr.AddReference('ProtoGeometry')
from Autodesk.DesignScript.Geometry import *
clr.AddReference("RevitNodes")
import Revit
clr.ImportExtensions(Revit.Elements)
clr.ImportExtensions(Revit.GeometryConversion)
clr.AddReference("RevitServices")
import RevitServices
from RevitServices.Persistence import DocumentManager 
from RevitServices.Transactions import TransactionManager 

clr.AddReference("RevitAPI")
clr.AddReference("RevitAPIUI")

import Autodesk 
from Autodesk.Revit.DB import *
from Autodesk.Revit.UI import *

doc = DocumentManager.Instance.CurrentDBDocument
uiapp = DocumentManager.Instance.CurrentUIApplication 
app = uiapp.Application 
uidoc = uiapp.ActiveUIDocument


#######OK NOW YOU CAN CODE########

# The inputs to this node will be stored as a list in the IN variables.
OLinput=IN[0]
OccType=IN[1]

# Place your code below this line
#emptyList = []

#OCCUPANCY TYPES - INSTITUTIONAL AND RESIDENTINAL NOT INCLUDED
occupancytypes=("A-1","A-2","A-3","A-4","A-5","B","E","F1","F2","M","S-1","S-2")


empty = ["No rooms in this occ"]
out = []

OL = round(OLinput[0])
OLF = OL/2
OLM = OL/2


wcm = []
wcf = []
ur = []
lvm= []
lvf= [] 
bth= []
df= []
ss= []


# A1---------------------- A1------------------------------A1 ------------------------------A1 ------------------------------A1 ------------------------------A1


try:
	if OccType==occupancytypes[0]:
		#A1 Male WC
		if OLM<100:
			wcm.append(OLM/100)
		elif OLM<200:
			wcm.append(1+(OLM-100)/100)
		elif OLM<400:
			wcm.append(2+(OLM-200)/200)
		else:
			wcm.append(3+(OLM-400)/500) 

		#A1 Female WC
		if OLF<25:
			wcf.append(OLF/25)
		elif OLF<50:
			wcf.append(1+(OLF-25)/25)
		elif OLF<100:
			wcf.append(2+(OLF-50)/50)
		elif OLF<200:
			wcf.append(3+(OLF-100)/100)
		elif OLF<300:
			wcf.append(4+(OLF-200)*((6-4)/(300-200)))	
		elif OLF<400:
			wcf.append(6+(OLF-300)*((8-6)/(400-300)))
		else:
			wcf.append(8+(OLF-400)/125)

		#A1 URINALS
		if OLM<200:
			ur.append(OLM/200)
		elif OLM<300:
			ur.append(1+(OLM-200)/100)
		elif OLM<400:
			ur.append(2+(OLM-300)/100)
		elif OLM<600:
			ur.append(3+(OLM-400)/200)
		else:
			ur.append(4+(OLM-600)/300)

		#A1 Male LAVATORIES
		if OLM<200:
			lvm.append(OLM/200)
		elif OLM<400:
			lvm.append(1+(OLM-200)/200)
		elif OLM<600:
			lvm.append(2+(OLM-400)/200)
		elif OLM<750:
			lvm.append(3+(OLM-600)/150)
		else:
			lvm.append(4+(OLM-750)/250)

		# Female LAVATORIES
		if OLF<100:
			lvf.append(OLF/100)
		elif OLF<200:
			lvf.append(1+(OLF-100)/100)
		elif OLF<300:
			lvf.append(2+(OLF-200)*((4-2)/(300-200)))
		elif OLF<500:
			lvf.append(4+(OLF-300)/200)
		elif OLF<750:
			lvf.append(5+(OLF-500)/250)
		else:
			lvf.append(6+(OLF-750)/200)

		#A1 SHOWERS/BATHUB
		bth.append(0)

		#A1 DRINKING FOUNTAIN
		if OL<250:
			df.append(OL/250)
		elif OL<500:
			df.append(1+(OL-250)/250)
		elif OL<750:
			df.append(2+(OL-500)/250)
		else:
			df.append(3+(OL-750)/500)
		#A1 OTHER	
		ss.append(1)
	

except:
	empty

# A2---------------------- A2------------------------------A2 ------------------------------A2 ------------------------------A2 ------------------------------A2


try:
	if OccType==occupancytypes[1]:
		#A2 Male WC
		if OLM<50:
			wcm.append(OLM/50)
		elif OLM<150:
			wcm.append(1+(OLM-50)/100)
		elif OLM<300:
			wcm.append(2+(OLM-150)/150)
		elif OLM<400:
			wcm.append(3+(OLM-300)/100)
		else:
			wcm.append(4+(OLM-400)/250) 

		#A2 Female WC
		if OLF<25:
			wcf.append(OLF/25)
		elif OLF<50:
			wcf.append(1+(OLF-25)/25)
		elif OLF<100:
			wcf.append(2+(OLF-50)/50)
		elif OLF<200:
			wcf.append(3+(OLF-100)/100)
		elif OLF<300:
			wcf.append(4+(OLF-200)*((6-4)/(300-200)))	
		elif OLF<400:
			wcf.append(6+(OLF-300)*((8-6)/(400-300)))
		else:
			wcf.append(8+(OLF-400)/125)

		# URINALS
		if OLM<200:
			ur.append(OLM/200)
		elif OLM<300:
			ur.append(1+(OLM-200)/100)
		elif OLM<400:
			ur.append(2+(OLM-300)/100)
		elif OLM<600:
			ur.append(3+(OLM-400)/200)
		else:
			ur.append(4+(OLM-600)/300)

		# Male LAVATORIES
		if OLM<150:
			lvm.append(OLM/150)
		elif OLM<200:
			lvm.append(1+(OLM-150)/50)
		elif OLM<400:
			lvm.append(2+(OLM-200)/200)
		else:
			lvm.append(3+(OLM-400)/250)

		# Female LAVATORIES
		if OLF<150:
			lvf.append(OLF/150)
		elif OLF<200:
			lvf.append(1+(OLF-150)/50)
		elif OLF<400:
			lvf.append(2+(OLF-200)*((4-2)/(400-200)))
		else:
			lvf.append(4+(OLF-400)/200)

		# SHOWERS/BATHUB
		bth.append(0)

		# DRINKING FOUNTAIN
		if OL<250:
			df.append(OL/250)
		elif OL<500:
			df.append(1+(OL-250)/250)
		elif OL<750:
			df.append(2+(OL-500)/250)
		else:
			df.append(3+(OL-750)/500)
		# OTHER	
		ss.append(1)

		
except:
	empty			

# A3---------------------- A3------------------------------A3 ------------------------------A3 ------------------------------A3 ------------------------------A3


try:
	if OccType==occupancytypes[2]:
		#A3 Male WC
		if OLM<100:
			wcm.append(OLM/100)
		elif OLM<200:
			wcm.append(1+(OLM-100)/100)
		elif OLM<400:
			wcm.append(2+(OLM-200)/200)
		else:
			wcm.append(4+(OLM-400)/500) 

		# Female WC
		if OLF<25:
			wcf.append(OLF/25)
		elif OLF<50:
			wcf.append(1+(OLF-25)/25)
		elif OLF<100:
			wcf.append(2+(OLF-50)/50)
		elif OLF<200:
			wcf.append(3+(OLF-100)/100)
		elif OLF<300:
			wcf.append(4+(OLF-200)*((6-4)/(300-200)))	
		elif OLF<400:
			wcf.append(6+(OLF-300)*((8-6)/(400-300)))
		else:
			wcf.append(8+(OLF-400)/125)

		# URINALS
		if OLM<100:
			ur.append(OLM/100)
		elif OLM<200:
			ur.append(1+(OLM-100)/100)
		elif OLM<400:
			ur.append(2+(OLM-200)/200)
		elif OLM<600:
			ur.append(3+(OLM-400)/200)
		else:
			ur.append(4+(OLM-600)/300)

		# Male LAVATORIES
		if OLM<200:
			lvm.append(OLM/200)
		elif OLM<400:
			lvm.append(1+(OLM-200)/200)
		elif OLM<600:
			lvm.append(2+(OLM-400)/200)
		elif OLM<750:
			lvm.append(3+(OLM-600)/150)
		else:
			lvm.append(3+(OLM-750)/250)

		# Female LAVATORIES
		if OLF<100:
			lvf.append(OLF/100)
		elif OLF<200:
			lvf.append(1+(OLF-100)/100)
		elif OLF<300:
			lvf.append(2+(OLF-200)*((4-2)/(300-200)))
		elif OLF<500:
			lvf.append(4+(OLF-300)/200)
		elif OLF<750:
			lvf.append(5+(OLF-500)/250)
		else:
			lvf.append(6+(OLF-750)/200)

		# SHOWERS/BATHUB
		bth.append(0)

		# DRINKING FOUNTAIN
		if OL<250:
			df.append(OL/250)
		elif OL<500:
			df.append(1+(OL-250)/250)
		elif OL<750:
			df.append(2+(OL-500)/250)
		else:
			df.append(3+(OL-750)/500)
		# OTHER	
		ss.append(1)
	
except:
	empty
# A4---------------------- A4------------------------------A4 ------------------------------A4 ------------------------------A4 ------------------------------A4


try:
	if OccType==occupancytypes[3]:
		#A4 Male WC
		if OLM<100:
			wcm.append(OLM/100)
		elif OLM<200:
			wcm.append(1+(OLM-100)/100)
		elif OLM<400:
			wcm.append(2+(OLM-200)/200)
		else:
			wcm.append(4+(OLM-400)/500) 

		# Female WC
		if OLF<25:
			wcf.append(OLF/25)
		elif OLF<50:
			wcf.append(1+(OLF-25)/25)
		elif OLF<100:
			wcf.append(2+(OLF-50)/50)
		elif OLF<200:
			wcf.append(3+(OLF-100)/100)
		elif OLF<300:
			wcf.append(4+(OLF-200)*((6-4)/(300-200)))	
		elif OLF<400:
			wcf.append(6+(OLF-300)*((8-6)/(400-300)))
		else:
			wcf.append(8+(OLF-400)/125)

		# URINALS
		if OLM<100:
			ur.append(OLM/100)
		elif OLM<200:
			ur.append(1+(OLM-100)/100)
		elif OLM<400:
			ur.append(2+(OLM-200)/200)
		elif OLM<600:
			ur.append(3+(OLM-400)/200)
		else:
			ur.append(4+(OLM-600)/300)

		# Male LAVATORIES
		if OLM<200:
			lvm.append(OLM/200)
		elif OLM<400:
			lvm.append(1+(OLM-200)/200)
		elif OLM<750:
			lvm.append(2+(OLM-400)/350)
		else:
			lvm.append(3+(OLM-750)/250)

		# Female LAVATORIES
		if OLF<100:
			lvf.append(OLF/100)
		elif OLF<200:
			lvf.append(1+(OLF-100)/100)
		elif OLF<300:
			lvf.append(2+(OLF-200)*((4-2)/(300-200)))
		elif OLF<500:
			lvf.append(4+(OLF-300)/200)
		elif OLF<750:
			lvf.append(5+(OLF-500)/250)
		else:
			lvf.append(6+(OLF-750)/200)

		# SHOWERS/BATHUB
		bth.append(0)

		# DRINKING FOUNTAIN
		if OL<250:
			df.append(OL/250)
		elif OL<500:
			df.append(1+(OL-250)/250)
		elif OL<750:
			df.append(2+(OL-500)/250)
		else:
			df.append(3+(OL-750)/500)
		# OTHER	
		ss.append(1)

except:
	empty

# A5---------------------- A5------------------------------A5 ------------------------------A5 ------------------------------A5 ------------------------------A5


try:
	if OccType==occupancytypes[4]:
		#A5 Male WC
		if OLM<100:
			wcm.append(OLM/100)
		elif OLM<200:
			wcm.append(1+(OLM-100)/100)
		elif OLM<400:
			wcm.append(2+(OLM-200)/200)
		else:
			wcm.append(4+(OLM-400)/500) 

		# Female WC
		if OLF<25:
			wcf.append(OLF/25)
		elif OLF<50:
			wcf.append(1+(OLF-25)/25)
		elif OLF<100:
			wcf.append(2+(OLF-50)/50)
		elif OLF<200:
			wcf.append(3+(OLF-100)/100)
		elif OLF<300:
			wcf.append(4+(OLF-200)*((6-4)/(300-200)))
		elif OLF<400:
			wcf.append(6+(OLF-300)*((8-6)/(400-300)))
		else:
			wcf.append(8+(OLF-400)/125)

		# URINALS
		if OLM<100:
			ur.append(OLM/100)
		elif OLM<200:
			ur.append(1+(OLM-100)/100)
		elif OLM<400:
			ur.append(2+(OLM-200)/200)
		elif OLM<600:
			ur.append(3+(OLM-400)/200)
		else:
			ur.append(4+(OLM-600)/300)

		# Male LAVATORIES
		if OLM<200:
			lvm.append(OLM/200)
		elif OLM<400:
			lvm.append(1+(OLM-200)/200)
		elif OLM<750:
			lvm.append(2+(OLM-600)/150)
		else:
			lvm.append(3+(OLM-750)/250)

		# Female LAVATORIES
		if OLF<100:
			lvf.append(OLF/100)
		elif OLF<200:
			lvf.append(1+(OLF-100)/100)
		elif OLF<300:
			lvf.append(2+(OLF-200)*((4-2)/(300-200)))
		elif OLF<500:
			lvf.append(4+(OLF-300)/200)
		elif OLF<750:
			lvf.append(5+(OLF-500)/250)
		else:
			lvf.append(6+(OLF-750)/200)

		# SHOWERS/BATHUB
		bth.append(0)

		# DRINKING FOUNTAIN
		if OL<250:
			df.append(OL/250)
		elif OL<500:
			df.append(1+(OL-250)/250)
		elif OL<750:
			df.append(2+(OL-500)/250)
		else:
			df.append(3+(OL-750)/500)
		# OTHER	
		ss.append(1)

except:
	empty

# B---------------------- B------------------------------B ------------------------------B ------------------------------B ------------------------------B

try:
	if OccType==occupancytypes[5]:
		#B Male WC
		if OLM<50:
			wcm.append(OLM/50)
		elif OLM<100:
			wcm.append(1+(OLM-50)/50)
		elif OLM<200:
			wcm.append(2+(OLM-100)/100)
		elif OLM<400:
			wcm.append(3+(OLM-200)/200)
		else:
			wcm.append(4+(OLM-400)/500) 

		# Female WC
		if OLF<15:
			wcf.append(OLF/15)
		elif OLF<30:
			wcf.append(1+(OLF-15)/15)
		elif OLF<50:
			wcf.append(2+(OLF-30)/20)
		elif OLF<100:
			wcf.append(3+(OLF-50)/50)
		elif OLF<200:
			wcf.append(4+(OLF-100)*((8.0-4)/(200-100)))
		elif OLF<400:
			wcf.append(8+(OLF-200)*((11-8)/(400-200)))
		else:
			wcf.append(11+(OLF-400)/150)

		# URINALS
		if OLM<100:
			ur.append(OLM/100)
		elif OLM<200:
			ur.append(1+(OLM-100)/100)
		elif OLM<400:
			ur.append(2+(OLM-200)/200)
		elif OLM<600:
			ur.append(3+(OLM-400)/200)
		else:
			ur.append(4+(OLM-600)/300)

		# Male LAVATORIES
		if OLM<75:
			lvm.append(OLM/75)
		elif OLM<150:
			lvm.append(1+(OLM-75)/75)
		elif OLM<200:
			lvm.append(2+(OLM-150)/50)
		elif OLM<300:
			lvm.append(3+(OLM-200)/100)
		elif OLM<400:
			lvm.append(4+(OLM-300)/100)
		else:
			lvm.append(5+(OLM-400)/250)

		# Female LAVATORIES
		if OLF<50:
			lvf.append(OLF/50)
		elif OLF<100:
			lvf.append(1+(OLF-50)/50)
		elif OLF<150:
			lvf.append(2+(OLF-100)/50)
		elif OLF<200:
			lvf.append(3+(OLF-150)/50)
		elif OLF<300:
			lvf.append(4+(OLF-200)/100)
		elif OLF<400:
			lvf.append(5+(OLF-300)/100)
		else:
			lvf.append(6+(OLF-400)/200)

		# SHOWERS/ATHU
		bth.append(0)

		# DRINKING FOUNTAIN
		df.append(OL/150)
		
		# OTHER	
		ss.append(1)
		
except:
	empty 
# E---------------------- E------------------------------E ------------------------------E ------------------------------E ------------------------------E


try:
	if OccType==occupancytypes[6]:
		#E Male WC
		wcm.append(OLM/50)

		# Female WC
		wcf.append(OLF/30)

		# URINALS
		ur.append(OLM/100)

		# Male LAVATORIS
		lvm.append(OLM/40)

		# Female LAVATORIS
		lvf.append(OLF/40)

		# SHOWRS/ATHU
		bth.append(0)

		# DRINKING FOUNTAIN
		df.append(OL/150)

		# OTHR	
		ss.append(1)

except:
	empty


# F1---------------------- F1------------------------------F1 ------------------------------F1 ------------------------------F1 ------------------------------F1

try:
	if OccType==occupancytypes[7]:
		#F1 Male WC
		if OLM<50:
			wcm.append(OLM/50)
		elif OLM<75:
			wcm.append(1+(OLM-50)/25)
		elif OLM<100:
			wcm.append(2+(OLM-100)/25)
		else:
			wcm.append(3+(OLM-100)/40) 

		# Female WC
		if OLF<50:
			wcf.append(OLF/50)
		elif OLF<75:
			wcf.append(1+(OLF-50)/25)
		elif OLFF<100:
			wcf.append(2+(OLF-75)/25)
		else:
			wcf.append(8+(OLF-400)/40)

		# URINALS
		ur.append(0)

		# Male LAVATORIES
		if OLM<50:
			lvm.append(OLM/50)
		elif OLM<75:
			lvm.append(1+(OLM-50)/25)
		elif OLM<100:
			lvm.append(2+(OLM-75)/25)
		else:
			lvm.append(4+(OLM-100)/40)

		# Female LAVATORIES
		if OLF<50:
			lvf.append(OLF/50)
		elif OLF<75:
			lvfF.append(1+(OLF-50)/25)
		elif OLFF<100:
			lvfF.append(2+(OLF-75)/25)
		else:
			lvfF.append(6+(OLF-100)/40)

		#F SHOWERS/BATHUB
		bth.append("1 shower for each 15 persons exposed to excessive heat or to skin contamination")

		# DRINKING FOUNTAIN
		if OL<250:
			df.append(OL/250)
		elif OL<500:
			df.append(1+(OL-250)/250)
		elif OL<750:
			df.append(2+(OL-500)/250)
		else:
			df.append(3+(OL-750)/500)
		# OTHER	
		ss.append(1)
		
except:
	empty

# F2---------------------- F2------------------------------F2 ------------------------------F2 ------------------------------F2 ------------------------------F2



try:
	if OccType==occupancytypes[8]:
		#F2 Male WC
		if OLM<50:
			wcm.append(OLM/50)
		elif OLM<75:
			wcm.append(1+(OLM-50)/25)
		elif OLM<100:
			wcm.append(2+(OLM-100)/25)
		else:
			wcm.append(3+(OLM-100)/40) 

		# Female WC
		if OLF<50:
			wcf.append(OLF/50)
		elif OLF<75:
			wcf.append(1+(OLF-50)/25)
		elif OLFF<100:
			wcf.append(2+(OLF-75)/25)
		else:
			wcf.append(8+(OLF-400)/40)

		# URINALS
		ur.append(0)

		# Male LAVATORIES
		if OLM<50:
			lvm.append(OLM/50)
		elif OLM<75:
			lvm.append(1+(OLM-50)/25)
		elif OLM<100:
			lvm.append(2+(OLM-75)/25)
		else:
			lvm.append(4+(OLM-100)/40)

		# Female LAVATORIES
		if OLF<50:
			lvf.append(OLF/50)
		elif OLF<75:
			lvfF.append(1+(OLF-50)/25)
		elif OLFF<100:
			lvfF.append(2+(OLF-75)/25)
		else:
			lvfF.append(6+(OLF-100)/40)

		#F SHOWERS/BATHUB
		bth.append("1 shower for each 15 persons exposed to excessive heat or to skin contamination")

		# DRINKING FOUNTAIN
		if OL<250:
			df.append(OL/250)
		elif OL<500:
			df.append(1+(OL-250)/250)
		elif OL<750:
			df.append(2+(OL-500)/250)
		else:
			df.append(3+(OL-750)/500)
		# OTHER	
		ss.append(1)

except:
	empty 

#  M---------------------- M------------------------------M ------------------------------M ------------------------------M ------------------------------M


try:
	if OccType==occupancytypes[9]:
		#M Male WC
		if OLM<100:
			wcm.append(OLM/100)
		elif OLM<200:
			wcm.append(1+(OLM-100)/100)
		elif OLM<400:
			wcm.append(2+(OLM-200)/200)
		else:
			wcm.append(3+(OLM-400)/500) 

		#M Female WC
		if OLF<100:
			wcf.append(OLF/100)
		elif OLF<200:
			wcf.append(1+(OLF-100)/100)
		elif OLF<300:
			wcf.append(2+(OLF-200)*((4-2)/(300-200)))
		elif OLF<400:
			wcf.append(3+(OLF-300)*((6-4)/(400-300)))
		else:
			wcf.append(8+(OLF-400)/200)

		#M URINALS
		if OLM<200:
			ur.append(OLM/200)
		elif OLM<400:
			ur.append(0+(OLM-200)/200)
		else:
			ur.append(1+(OLM-400)/500)

		#M Male LAVATORIES
		if OLM<200:
			lvm.append(OLM/200)
		elif OLM<400:
			lvm.append(1+(OLM-200)/200)
		else:
			lvm.append(2+(OLM-400)/500)

		#M Female LAVATORIES
		if OLF<200:
			lvf.append(OLF/200)
		elif OLF<300:
			lvf.append(1+(OLF-200)/100)
		elif OLF<400:
			lvf.append(2+(OLF-300)/100)
		else:
			lvf.append(3+(OLF-400)/400)

		#M SHOWERS/BATHUB
		bth.append(0)

		#M DRINKING MOUNTAIN
		if OLM<250:
			df.append(OLM/250)
		elif OLM<500:
			df.append(1+(OLM-250)/250)
		elif OLM<750:
			df.append(2+(OLM-500)/250)
		else:
			df.append(3+(OLM-750)/500)
		#M OTHMR	
		ss.append(1)

		
except:
	empty
# S1---------------------- S1------------------------------S1 ------------------------------S1 ------------------------------S1 ------------------------------S1


try:
	if OccType==occupancytypes[10]:
		#S1 Male WC
		if OLM<100:
			wcm.append(OLM/100)
		elif OLM<200:
			wcm.append(1+(OLM-100)/100)
		elif OLM<400:
			wcm.append(2+(OLM-200)/200)
		else:
			wcm.append(3+(OLM-400)/500) 

		#S1 Female WC
		if OLF<100:
			wcf.append(OLF/100)
		elif OLF<200:
			wcf.append(1+(OLF-100)/100)
		elif OLF<400:
			wcf.append(2+(OLF-200)/200)
		else:
			wcf.append(3+(OLF-400)/150)

		#S1 URINALS1
		ur.append(0)

		#S1 Male LAVATORIES
		if OLM<200:
			lvm.append(OLM/200)
		elif OLMS1<400:
			lvm.append(1+(OLM-200)/200)
		elif OLM<750:
			lvm.append(2+(OLM-400)/350)
		else:
			lvm.append(3+(OLM-750)/500)

		#S1 Female LAVATORIES1
		if OLF<200:
			lvf.append(OLF/200)
		elif OLF<400:
			lvf.append(1+(OLF-100)/200)
		elif OLF<750:
			lvf.append(2+(OLF-400)/350)
		else:
			lvf.append(3+(OLF-750)/500)

		#S1 S1HOWERS1/BATHUB
		bth.append(0)

		#S1 DRINKING FOUNTAIN
		if OL<250:
			df.append(OL/250)
		elif OL<500:
			df.append(1+(OL-250)/250)
		elif OL<750:
			df.append(2+(OL-500)/250)
		else:
			df.append(3+(OL-750)/500)
		#S1 OTHER	
		ss.append(1)
		
except:
	empty

# S2---------------------- S2------------------------------S2 ------------------------------S2 ------------------------------S2 ------------------------------S2


try: 
	if OccType==occupancytypes[11]:
		#S2 Male WC
		if OLM<100:
			wcm.append(OLM/100)
		elif OLM<200:
			wcm.append(1+(OLM-100)/100)
		elif OLM<400:
			wcm.append(2+(OLM-200)/200)
		else:
			wcm.append(3+(OLM-400)/500) 

		#S2 Female WC
		if OLF<100:
			wcf.append(OLF/100)
		elif OLF<200:
			wcf.append(1+(OLF-100)/100)
		elif OLF<400:
			wcf.append(2+(OLF-200)/200)
		else:
			wcf.append(3+(OLF-400)/150)

		#S2 URINALS2
		ur.append(0)

		#S2 Male LAVATORIES
		if OLM<200:
			lvm.append(OLM/200)
		elif OLM<400:
			lvm.append(1+(OLM-200)/200)
		elif OLM<750:
			lvm.append(2+(OLM-400)/350)
		else:
			lvm.append(3+(OLM-750)/500)

		#S2 Female LAVATORIES2
		if OLF<200:
			lvf.append(OLF/200)
		elif OLF<400:
			lvf.append(1+(OLF-100)/200)
		elif OLF<750:
			lvf.append(2+(OLF-400)/350)
		else:
			lvf.append(3+(OLF-750)/500)

		# SHOWERS/BATHUB
		bth.append(0)

		#S2 DRINKING FOUNTAIN
		if OL<250:
			df.append(OL/250)
		elif OL<500:
			df.append(1+(OL-250)/250)
		elif OL<750:
			df.append(2+(OL-500)/250)
		else:
			df.append(3+(OL-750)/500)
		#S2 OTHER	
		ss.append(1)

		
except:
	empty

# Assign your output to the OUT variable.

OUT = wcm,wcf,ur,lvm,lvf,bth,df,ss



# This script was written by Agustina Aboy
# https://twitter.com/agusaboy
# Copyright (c) 2021 the ASG gang
# https://github.com/archsourcing/plumbing-fixture-calcs
# ----------------------------------------

# group: OUTPUTS
string = StringInput("*INSTITUTIONAL AND RESIDENTIAL OCCUPANCY TYPES NOT INCLUDED*")
note = Watch(string)  # graph output
byKeysValues = DesignScript.Builtin.Dictionary.ByKeysValues(keys=code_block_2, values=plumbing_fixture_calculations)  # graph output

# group: Set Parameters
code_block_5 = CodeBlock(a=code_block)
# ---------- code_block_5.designscript (12 lines) ----------
a+"OccType";
a+"OLF";
a+"AREA";
a+"M WC";
a+"F WC";
a+"URINAL";
a+"M LAV.";
a+"F LAV.";
a+"DF";
a+"SS";
a+"Diagonal Lines";
a+"Diagonal Lines - SS";
# ----------------------------------------
setParameterByName = Element.SetParameterByName(element=select_ga_plumbing_facilities, parameterName=code_block_5.out0, value=occupancy_type_a_1_a_2_a_3_a_4_a)
setParameterByName_2 = Element.SetParameterByName(element=select_ga_plumbing_facilities, parameterName=code_block_5.out1, value=OLF)
setParameterByName_3 = Element.SetParameterByName(element=select_ga_plumbing_facilities, parameterName=code_block_5.out2, value=area_manual_input)
code_block_6 = CodeBlock { "wcm"; }
valueAtKey = DesignScript.Builtin.Dictionary.ValueAtKey(dictionary=byKeysValues, key=code_block_6)
setParameterByName_4 = Element.SetParameterByName(element=select_ga_plumbing_facilities, parameterName=code_block_5.out3, value=valueAtKey)
code_block_7 = CodeBlock { "wcf"; }
valueAtKey_2 = DesignScript.Builtin.Dictionary.ValueAtKey(dictionary=byKeysValues, key=code_block_7)
setParameterByName_5 = Element.SetParameterByName(element=select_ga_plumbing_facilities, parameterName=code_block_5.out4, value=valueAtKey_2)
code_block_8 = CodeBlock { "ur"; }
valueAtKey_3 = DesignScript.Builtin.Dictionary.ValueAtKey(dictionary=byKeysValues, key=code_block_8)
setParameterByName_6 = Element.SetParameterByName(element=select_ga_plumbing_facilities, parameterName=code_block_5.out5, value=valueAtKey_3)
code_block_9 = CodeBlock { "lvm"; }
valueAtKey_4 = DesignScript.Builtin.Dictionary.ValueAtKey(dictionary=byKeysValues, key=code_block_9)
setParameterByName_7 = Element.SetParameterByName(element=select_ga_plumbing_facilities, parameterName=code_block_5.out6, value=valueAtKey_4)
code_block_10 = CodeBlock { "lvf"; }
valueAtKey_5 = DesignScript.Builtin.Dictionary.ValueAtKey(dictionary=byKeysValues, key=code_block_10)
setParameterByName_8 = Element.SetParameterByName(element=select_ga_plumbing_facilities, parameterName=code_block_5.out7, value=valueAtKey_5)
code_block_11 = CodeBlock { "df"; }
valueAtKey_6 = DesignScript.Builtin.Dictionary.ValueAtKey(dictionary=byKeysValues, key=code_block_11)
setParameterByName_9 = Element.SetParameterByName(element=select_ga_plumbing_facilities, parameterName=code_block_5.out8, value=valueAtKey_6)
code_block_12 = CodeBlock { "ss"; }
valueAtKey_7 = DesignScript.Builtin.Dictionary.ValueAtKey(dictionary=byKeysValues, key=code_block_12)
setParameterByName_10 = Element.SetParameterByName(element=select_ga_plumbing_facilities, parameterName=code_block_5.out9, value=valueAtKey_7)
